# Grasshopper definition Monkey.gh (Grasshopper 1.0.7)
# plug-ins: Monkey, Human

crv = Curve([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])
data = Data(["this", "this", "this", "is", "is", "a", "duplicated", "duplicated", "string", "1", "1", "1", "2", "2", "3"])
data_2 = Data([0, 1, 2, 3, 4])
panel = Panel(data_2)
loft = Loft(Curves=crv, Options={Adjust=False, Closed=False, LoftEnds=0, LoftSimp=0, LoftType=0, Rebuild=10, Refit=0.01})
panel_2 = Panel(data)
pt = Point(Point(-7.147788484, -23.50705651, 0))
crv_2 = Curve(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)
panel_3 = Panel("""2
12""")
brep = Brep([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])
culldup = CullDuplicates(Data=panel_2)
dla = DLACrawl(
    Geo=loft,
    Point=pt,
    AttractorCurve=crv_2,
    SimulationAttribute="{ \"interval\": 10, \"maxStep\": 200 }",
    Scale=1,
    AttractorWeight=0.1)
cullnull = CullNull(InputList=panel)
listseg = ListSegment(List=brep, Number=Slider(0, range=0..10), Mode="Half")  # -> FirstNItems, MiddleItems, LastNItems
padnum = PadNumber(Number=panel_3, Digits=Slider(3, range=0..10))
panel_4 = Panel(culldup)
panel_5 = Panel(cullnull)
brep_2 = Brep(listseg.FirstNItems)
brep_3 = Brep(listseg.MiddleItems)
brep_4 = Brep(listseg.LastNItems)
panel_6 = Panel(padnum)
visualizer = DLAVisualzier(DLALines=dla)  # -> Parameters, Thickness
gradient = Gradient(
    LowerLimit=0,
    UpperLimit=1,
    Parameter=visualizer.Parameters,
    stops=[0: RGB(0, 98, 0), 0.25: RGB(81, 175, 17), 0.5: RGB(159, 198, 146), 0.75: RGB(170, 235, 41), 1: RGB(221, 255, 53)])
list = ValueList({"Autodesk FBX (.fbx)": ".fbx", "Wavefront OBJ (.obj)": ".obj", "Rhino 3D Model (.3dm)": ".3dm", "Stereolithography (.stl)": ".stl", "3D Studio (.3ds)": ".3ds", "Collada (.dae)": ".dae"}, selected="Autodesk FBX (.fbx)")
path = CreatePath(Directory="D:\Test\2", Filename="item", FileExtension=list, Mode="object")
previewlw = CustomPreviewLineweights(Geometry=dla, Shader=gradient, Thickness=visualizer.Thickness, Absolute=False)
export = FileExport(Mesh=brep, Path=path, Run=False, BindMode=True)
